# Grasshopper definition for screen shot.gh (Grasshopper 1.0.7)
# plug-ins: DIVA Daylight, Ironbug.LBHB_Legacy

number_slider = Slider(0.76, range=0..1)
panel = Panel("""void plastic WhiteInteriorWall_70
0
0
5 0.7 0.7 0.7 0 0""")
panel_2 = Panel("""void plastic GenericCeiling_80
0
0
5 0.8 0.8 0.8 0 0""")
panel_3 = Panel("""void plastic TileFloor_40
0
0
5 0.4 0.4 0.4 0 0""")
panel_4 = Panel("""# Building material: Aluminium
# Reflectance: rho=0.885
void metal identifier
0
0
5  0.9 0.88 0.88  0.0 0.00""")
panel_5 = Panel("""# Building material: Hemlock Wood
# Reflectance: rho=0.416
void plastic identifier
0
0
5  0.5 0.5 0.5  0 0""")
panel_6 = Panel("""# Building material: Shiny Black Granite
# Reflectance: rho=0.099
void plastic identifier
0
0
5  0.25 0.25 0.25  0 0""")
radglassmaterial = Honeybee_RadianceGlassMaterial(
    materialName="window_1",
    RTransmittance=number_slider,
    GTransmittance=number_slider,
    BTransmittance=number_slider,
    refractiveIndex=1.52)  # -> avrgTrans, RADMaterial; plug-in component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
# Walls
brep = Brep([<brep referenced from the Rhino model> x4])
# Ceiling
brep_2 = Brep(<brep referenced from the Rhino model>)
# Floor
brep_3 = Brep(<brep referenced from the Rhino model>)
# Desk
brep_4 = Brep([<brep referenced from the Rhino model> x10])
# Glass
brep_5 = Brep([<brep referenced from the Rhino model> x10])
# Chair
brep_6 = Brep([<brep referenced from the Rhino model> x192])
# Metal legs
brep_7 = Brep([<brep referenced from the Rhino model> x6])
createhbsrfs = Honeybee_createHBSrfs(geometry=brep_7, srfType=0, RADMaterial=panel_4)  # -> out, simplify(HBSurface); plug-in component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
createhbsrfs_2 = Honeybee_createHBSrfs(geometry=brep_5, srfType=5, RADMaterial=radglassmaterial.RADMaterial)  # -> out, simplify(HBSurface); plug-in component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
createhbsrfs_3 = Honeybee_createHBSrfs(geometry=brep, srfType=0, RADMaterial=panel)  # -> out, simplify(HBSurface); plug-in component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
createhbsrfs_4 = Honeybee_createHBSrfs(geometry=brep_2, srfType=3, RADMaterial=panel_2)  # -> out, simplify(HBSurface); plug-in component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
createhbsrfs_5 = Honeybee_createHBSrfs(geometry=brep_3, srfType=2, RADMaterial=panel_3)  # -> out, simplify(HBSurface); plug-in component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
createhbsrfs_6 = Honeybee_createHBSrfs(geometry=brep_6, srfType=0, RADMaterial=panel_6)  # -> out, simplify(HBSurface); plug-in component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
createhbsrfs_7 = Honeybee_createHBSrfs(geometry=brep_4, srfType=0, RADMaterial=panel_5)  # -> out, simplify(HBSurface); plug-in component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
scene_object = SceneObject(
    Geometry=brep,
    BooleanValue_0=False,
    BooleanValue_1=False,
    Color_0=RGBA(0, 0, 0, 0),
    Color_1=RGBA(0, 0, 0, 0),
    Hidden_0=False,
    Hidden_1=False,
    IntegerValue_0=-2147483648,
    IntegerValue_1=-2147483648,
    IntervalMax_0=-1.797693135e+308,
    IntervalMax_1=-1.797693135e+308,
    IntervalMin_0=-1.797693135e+308,
    IntervalMin_1=-1.797693135e+308,
    Name_0="Geometry",
    Name_1="Material",
    NumberValue_0=-1.797693135e+308,
    NumberValue_1=-1.797693135e+308,
    OutputHidden_0=False,
    OutputName_0="Scene Object",
    TextValuePersistent_1="WhiteInteriorWall_70",
    TextValueVolatile_1="WhiteInteriorWall_70")
scene_object_2 = SceneObject(
    Geometry=brep_2,
    BooleanValue_0=False,
    BooleanValue_1=False,
    Color_0=RGBA(0, 0, 0, 0),
    Color_1=RGBA(0, 0, 0, 0),
    Hidden_0=False,
    Hidden_1=False,
    IntegerValue_0=-2147483648,
    IntegerValue_1=-2147483648,
    IntervalMax_0=-1.797693135e+308,
    IntervalMax_1=-1.797693135e+308,
    IntervalMin_0=-1.797693135e+308,
    IntervalMin_1=-1.797693135e+308,
    Name_0="Geometry",
    Name_1="Material",
    NumberValue_0=-1.797693135e+308,
    NumberValue_1=-1.797693135e+308,
    OutputHidden_0=False,
    OutputName_0="Scene Object",
    TextValuePersistent_1="GenericCeiling_80",
    TextValueVolatile_1="GenericCeiling_80")
scene_object_3 = SceneObject(
    Geometry=brep_3,
    BooleanValue_0=False,
    BooleanValue_1=False,
    Color_0=RGBA(0, 0, 0, 0),
    Color_1=RGBA(0, 0, 0, 0),
    Hidden_0=False,
    Hidden_1=False,
    IntegerValue_0=-2147483648,
    IntegerValue_1=-2147483648,
    IntervalMax_0=-1.797693135e+308,
    IntervalMax_1=-1.797693135e+308,
    IntervalMin_0=-1.797693135e+308,
    IntervalMin_1=-1.797693135e+308,
    Name_0="Geometry",
    Name_1="Material",
    NumberValue_0=-1.797693135e+308,
    NumberValue_1=-1.797693135e+308,
    OutputHidden_0=False,
    OutputName_0="Scene Object",
    TextValuePersistent_1="TileFloor_40",
    TextValueVolatile_1="TileFloor_40")
scene_object_4 = SceneObject(
    Geometry=brep_6,
    Material=panel_6,
    BooleanValue_0=False,
    BooleanValue_1=False,
    Color_0=RGBA(0, 0, 0, 0),
    Color_1=RGBA(0, 0, 0, 0),
    Hidden_0=False,
    Hidden_1=False,
    IntegerValue_0=-2147483648,
    IntegerValue_1=-2147483648,
    IntervalMax_0=-1.797693135e+308,
    IntervalMax_1=-1.797693135e+308,
    IntervalMin_0=-1.797693135e+308,
    IntervalMin_1=-1.797693135e+308,
    Name_0="Geometry",
    Name_1="Material",
    NumberValue_0=-1.797693135e+308,
    NumberValue_1=-1.797693135e+308,
    OutputHidden_0=False,
    OutputName_0="Scene Object",
    TextValuePersistent_1="TileFloor_40",
    TextValueVolatile_1="""# Building material: Shiny Black Granite
# Reflectance: rho=0.099
void plastic identifier
0
0
5  0.25 0.25 0.25  0 0""")
scene_object_5 = SceneObject(
    BooleanValue_0=False,
    BooleanValue_1=False,
    Color_0=RGBA(0, 0, 0, 0),
    Color_1=RGBA(0, 0, 0, 0),
    Hidden_0=False,
    Hidden_1=False,
    IntegerValue_0=-2147483648,
    IntegerValue_1=-2147483648,
    IntervalMax_0=-1.797693135e+308,
    IntervalMax_1=-1.797693135e+308,
    IntervalMin_0=-1.797693135e+308,
    IntervalMin_1=-1.797693135e+308,
    Name_0="Geometry",
    Name_1="Material",
    NumberValue_0=-1.797693135e+308,
    NumberValue_1=-1.797693135e+308,
    OutputHidden_0=False,
    OutputName_0="Scene Object",
    TextValuePersistent_1="TileFloor_40",
    TextValueVolatile_1="""# Building material: Light Blue Eternit
# Reflectance: rho=0.289
void plastic identifier
0
0
5  0.4 0.4 0.4  0 0""")  # disabled
scene_object_6 = SceneObject(
    Geometry=brep_4,
    Material=panel_5,
    BooleanValue_0=False,
    BooleanValue_1=False,
    Color_0=RGBA(0, 0, 0, 0),
    Color_1=RGBA(0, 0, 0, 0),
    Hidden_0=False,
    Hidden_1=False,
    IntegerValue_0=-2147483648,
    IntegerValue_1=-2147483648,
    IntervalMax_0=-1.797693135e+308,
    IntervalMax_1=-1.797693135e+308,
    IntervalMin_0=-1.797693135e+308,
    IntervalMin_1=-1.797693135e+308,
    Name_0="Geometry",
    Name_1="Material",
    NumberValue_0=-1.797693135e+308,
    NumberValue_1=-1.797693135e+308,
    OutputHidden_0=False,
    OutputName_0="Scene Object",
    TextValuePersistent_1="TileFloor_40",
    TextValueVolatile_1="""# Building material: Hemlock Wood
# Reflectance: rho=0.416
void plastic identifier
0
0
5  0.5 0.5 0.5  0 0""")
scene_object_7 = SceneObject(
    Geometry=brep_7,
    Material=panel_4,
    BooleanValue_0=False,
    BooleanValue_1=False,
    Color_0=RGBA(0, 0, 0, 0),
    Color_1=RGBA(0, 0, 0, 0),
    Hidden_0=False,
    Hidden_1=False,
    IntegerValue_0=-2147483648,
    IntegerValue_1=-2147483648,
    IntervalMax_0=-1.797693135e+308,
    IntervalMax_1=-1.797693135e+308,
    IntervalMin_0=-1.797693135e+308,
    IntervalMin_1=-1.797693135e+308,
    Name_0="Geometry",
    Name_1="Material",
    NumberValue_0=-1.797693135e+308,
    NumberValue_1=-1.797693135e+308,
    OutputHidden_0=False,
    OutputName_0="Scene Object",
    TextValuePersistent_1="TileFloor_40",
    TextValueVolatile_1="""# Building material: Aluminium
# Reflectance: rho=0.885
void metal identifier
0
0
5  0.9 0.88 0.88  0.0 0.00""")
sky = Sky(
    Month=1,
    Day=1,
    Hour=8,
    BooleanValue_0=False,
    BooleanValue_1=False,
    BooleanValue_2=False,
    BooleanValue_3=False,
    BooleanValue_4=False,
    BooleanValue_5=False,
    BooleanValue_6=False,
    BooleanValue_7=False,
    BooleanValue_8=False,
    BooleanValue_9=False,
    Color_0=RGBA(0, 0, 0, 0),
    Color_1=RGBA(0, 0, 0, 0),
    Color_2=RGBA(0, 0, 0, 0),
    Color_3=RGBA(0, 0, 0, 0),
    Color_4=RGBA(0, 0, 0, 0),
    Color_5=RGBA(0, 0, 0, 0),
    Color_6=RGBA(0, 0, 0, 0),
    Color_7=RGBA(0, 0, 0, 0),
    Color_8=RGBA(0, 0, 0, 0),
    Color_9=RGBA(0, 0, 0, 0),
    Hidden_0=False,
    Hidden_1=False,
    Hidden_2=False,
    Hidden_3=False,
    Hidden_4=False,
    Hidden_5=True,
    Hidden_6=True,
    Hidden_7=True,
    Hidden_8=True,
    Hidden_9=True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)
camera = Camera(
    XDim=400,
    YDim=400,
    BooleanValue_0=False,
    BooleanValue_1=False,
    BooleanValue_10=False,
    BooleanValue_11=False,
    BooleanValue_12=False,
    BooleanValue_13=False,
    BooleanValue_2=False,
    BooleanValue_3=False,
    BooleanValue_4=False,
    BooleanValue_5=False,
    BooleanValue_6=False,
    BooleanValue_7=False,
    BooleanValue_8=False,
    BooleanValue_9=False,
    Color_0=RGBA(0, 0, 0, 0),
    Color_1=RGBA(0, 0, 0, 0),
    Color_10=RGBA(0, 0, 0, 0),
    Color_11=RGBA(0, 0, 0, 0),
    Color_12=RGBA(0, 0, 0, 0),
    Color_13=RGBA(0, 0, 0, 0),
    Color_2=RGBA(0, 0, 0, 0),
    Color_3=RGBA(0, 0, 0, 0),
    Color_4=RGBA(0, 0, 0, 0),
    Color_5=RGBA(0, 0, 0, 0),
    Color_6=RGBA(0, 0, 0, 0),
    Color_7=RGBA(0, 0, 0, 0),
    Color_8=RGBA(0, 0, 0, 0),
    Color_9=RGBA(0, 0, 0, 0),
    Hidden_0=True,
    Hidden_1=False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)
merge = Merge(
    Data1=scene_object,
    Data2=scene_object_2,
    Data3=scene_object_3,
    Data4=scene_object_4,
    Data5=scene_object_5,
    Data6=scene_object_6,
    Data7=scene_object_7)
brep_8 = Brep(flatten([createhbsrfs_3.HBSurface, createhbsrfs_4.HBSurface, createhbsrfs_5.HBSurface, createhbsrfs_6.HBSurface, createhbsrfs.HBSurface, createhbsrfs_2.HBSurface, createhbsrfs_7.HBSurface]))
visualization = Visualization(
    Name="DasZimmer",
    Camera=camera,
    Objects=merge,
    RhinoScene=False,
    Sky=sky,
    Run=Button(),
    BooleanValue_0=False,
    BooleanValue_1=False,
    BooleanValue_10=False,
    BooleanValue_11=False,
    BooleanValue_12=False,
    BooleanValue_13=False,
    BooleanValue_14=False,
    BooleanValue_15=False,
    BooleanValue_16=False,
    BooleanValue_17=False,
    BooleanValue_18=False,
    BooleanValue_19=False,
    BooleanValue_2=False,
    BooleanValue_20=False,
    BooleanValue_21=False,
    BooleanValue_22=True,
    BooleanValue_23=True,
    BooleanValue_24=False,
    BooleanValue_25=False,
    BooleanValue_26=False,
    BooleanValue_27=False,
    BooleanValue_3=False,
    BooleanValue_4=False,
    BooleanValue_5=False,
    BooleanValue_6=False,
    BooleanValue_7=False,
    BooleanValue_8=False,
    BooleanValue_9=True,
    Color_0=RGBA(0, 0, 0, 0),
    Color_1=RGBA(0, 0, 0, 0)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)  # -> Out, Pic, Image, Falsecolor
ladybug = Ladybug_Ladybug()  # -> out; plug-in component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
honeybee = Honeybee_Honeybee()  # -> out; plug-in component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
false_start_toggle = FalseStartToggle(False)
image_viewer = ImageViewer(
    ImagePath=visualization.Image,
    Scale=1,
    enable_regions=False,
    save_tags=False,
    show_max=False,
    show_min=False,
    tag_size=15)
open_weather_file = Ladybug_OpenEPWWeatherFile(open=false_start_toggle)  # -> epwFile; plug-in component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
genclimatebasedsky = Honeybee_GenerateClimateBasedSky(weatherFile=open_weather_file, month=3, day=21, hour=16)  # -> out, skyFilePath; plug-in component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
radparameters = Honeybee_RADParameters(quality=1, ab=6)  # -> out, radParameters; plug-in component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
false_start_toggle_2 = FalseStartToggle(False)
panel_7 = Panel(genclimatebasedsky.skyFilePath)
imagebasedsimulation = Honeybee_ImageBasedSimulation(
    skyFile=genclimatebasedsky.skyFilePath,
    rhinoViewsName="View6_",
    cameraType=0,
    simulationType=2,
    imageWidth=1280,
    imageHeight=720,
    radParameters=radparameters.radParameters,
    backupImages=0)  # -> analysisRecipe; plug-in component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
vector_xyz = VectorXYZ(XComponent=0, YComponent=-1, ZComponent=0)  # -> Vector, Length
# -ps 2 -pt .05 -pj .9 -dj .7 -ds .15 - dt .05 -dc .75 -dr 3 -st .15 -aa 0.1 -ar 512 -ad 2048 -as 1024 -lr 8 -lw .005
point = Point([Point(0.5, 6.5, 0.200000003), Point(0.5, 6.5, 1.200000003), Point(0.5, 6.5, 2.200000003), Point(0.5, 6.5, 3.200000003), Point(1.5, 6.5, 0.200000003), Point(1.5, 6.5, 1.200000003)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])
rundaylightanalysis = Honeybee_RunDaylightSimulation(
    HBObjects=flatten(brep_8),
    analysisRecipe=imagebasedsimulation,
    writeRad=Button(),
    runRad=false_start_toggle_2,
    numOfCPUs=Slider(1, range=1..12),
    radFileName="thesisRoom12_8",
    overwriteResults=True)  # -> out, analysisType, resultsUnit, results, testPts, resultFiles, radGeoFile, studyFolder, done; plug-in component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
list_item = ListItem(List=point, Index=Slider(0, range=0..279), Wrap=True)
sensor = Sensor(
    Point=point,
    Vector=vector_xyz.Vector,
    BooleanValue_0=False,
    BooleanValue_1=False,
    Color_0=RGBA(0, 0, 0, 0),
    Color_1=RGBA(0, 0, 0, 0),
    Hidden_0=False,
    Hidden_1=False,
    IntegerValue_0=-2147483648,
    IntegerValue_1=-2147483648,
    IntervalMax_0=-1.797693135e+308,
    IntervalMax_1=-1.797693135e+308,
    IntervalMin_0=-1.797693135e+308,
    IntervalMin_1=-1.797693135e+308,
    Name_0="Point",
    Name_1="Vector",
    NumberValue_0=-1.797693135e+308,
    NumberValue_1=-1.797693135e+308)
daylighting_grid = DaylightingGrid(
    Spacing=0.45,
    Sensors=sensor,
    BooleanValue_0=False,
    BooleanValue_1=False,
    BooleanValue_10=False,
    BooleanValue_11=False,
    BooleanValue_12=False,
    BooleanValue_13=False,
    BooleanValue_14=False,
    BooleanValue_15=False,
    BooleanValue_16=False,
    BooleanValue_17=False,
    BooleanValue_18=False,
    BooleanValue_19=False,
    BooleanValue_2=False,
    BooleanValue_20=False,
    BooleanValue_21=False,
    BooleanValue_22=False,
    BooleanValue_3=False,
    BooleanValue_4=False,
    BooleanValue_5=False,
    BooleanValue_6=False,
    BooleanValue_7=False,
    BooleanValue_8=False,
    BooleanValue_9=False,
    Color_0=RGBA(0, 0, 0, 0),
    Color_1=RGBA(0, 0, 0, 0),
    Color_10=RGBA(0, 0, 0, 0),
    Color_11=RGBA(0, 0, 0, 0),
    Color_12=RGBA(0, 0, 0, 0),
    Color_13=RGBA(0, 0, 0, 0),
    Color_14=RGBA(0, 0, 0, 0)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)
annual_daylight = AnnualDaylight(
    Name="0,-1,0",
    Grids=daylighting_grid,
    Objects=merge,
    RhinoScene=False,
    Run=Button(),
    BooleanValue_0=False,
    BooleanValue_1=False,
    BooleanValue_10=False,
    BooleanValue_11=True,
    BooleanValue_12=True,
    BooleanValue_13=False,
    BooleanValue_14=False,
    BooleanValue_15=False,
    BooleanValue_16=False,
    BooleanValue_17=False,
    BooleanValue_2=False,
    BooleanValue_3=False,
    BooleanValue_4=False,
    BooleanValue_5=False,
    BooleanValue_6=False,
    BooleanValue_7=False,
    BooleanValue_8=False,
    BooleanValue_9=False,
    Color_0=RGBA(0, 0, 0, 0),
    Color_1=RGBA(0, 0, 0, 0),
    Color_10=RGBA(0, 0, 0, 0),
    Color_11=RGBA(0, 0, 0, 0),
    Color_12=RGBA(0, 0, 0, 0),
    Color_13=RGBA(0, 0, 0, 0),
    Color_14=RGBA(0, 0, 0, 0),
    Color_15=RGBA(0, 0, 0, 0),
    Color_16=RGBA(0, 0, 0, 0),
    Color_17=RGBA(0, 0, 0, 0),
    Color_2=RGBA(0, 0, 0, 0),
    Color_3=RGBA(0, 0, 0, 0)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)  # -> Out, SDA, ASE, LEEDv4, LightingEnergy, OpenPercentage, Windows, Grids, Zones
grid_viewer = GridViewer(
    Grid=annual_daylight.Grids,
    Month=1,
    Day=1,
    Hour=12,
    BooleanValue_0=False,
    BooleanValue_1=False,
    BooleanValue_10=False,
    BooleanValue_11=False,
    BooleanValue_12=False,
    BooleanValue_13=False,
    BooleanValue_14=False,
    BooleanValue_15=False,
    BooleanValue_16=False,
    BooleanValue_17=False,
    BooleanValue_18=False,
    BooleanValue_19=False,
    BooleanValue_2=False,
    BooleanValue_20=False,
    BooleanValue_3=False,
    BooleanValue_4=False,
    BooleanValue_5=False,
    BooleanValue_6=False,
    BooleanValue_7=False,
    BooleanValue_8=False,
    BooleanValue_9=False,
    Color_0=RGBA(0, 0, 0, 0),
    Color_1=RGBA(0, 0, 0, 0),
    Color_10=RGBA(0, 0, 0, 0),
    Color_11=RGBA(0, 0, 0, 0),
    Color_12=RGBA(0, 0, 0, 0),
    Color_13=RGBA(0, 0, 0, 0),
    Color_14=RGBA(0, 0, 0, 0),
    Color_15=RGBA(0, 0, 0, 0),
    Color_16=RGBA(0, 0, 0, 0)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)  # -> SensorPts, SensorData
