# Grasshopper definition Honeybee_Annual_Daylight_Simulation_Example.gh (Grasshopper 1.0.7)
# plug-ins: Ironbug.LBHB_Legacy

honeybee = Honeybee_Honeybee()  # -> Vviiiiiiiiiizzz; plug-in component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
ladybug = Ladybug_Ladybug()  # -> Vviiiiiiiiiizzz; plug-in component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
# Floor
number_slider = Slider(0.3, range=0..1)
# Convert the box to Honeybee zone
# All the material will be set to default
# In case you want to change them search
# for Honeybee_Set Radiance Materials
# component.
box = DomainBox(Base=PlaneXY(0, 0, 0), X=Slider(4.2, range=0..10), Y=Slider(7, range=0..10), Z=Slider(3.2, range=0..10))
mass2zone = Honeybee_Masses2Zones(zoneMasses=flatten(box), isConditioned=True, maxRoofAngle=30, createHBZones=Toggle(True))  # -> readMe, HBZones; plug-in component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
number_slider_2 = Slider(0.76, range=0..1)
panel = Panel("""void plastic TileFloor_40
0
0
5 0.4 0.4 0.4 0 0""")
panel_2 = Panel("""# Building material: Aluminium
# Reflectance: rho=0.885
void metal identifier
0
0
5  0.9 0.88 0.88  0.0 0.00""")
panel_3 = Panel("""# Building material: Hemlock Wood
# Reflectance: rho=0.416
void plastic identifier
0
0
5  0.5 0.5 0.5  0 0""")
panel_4 = Panel("""# Building material: Shiny Black Granite
# Reflectance: rho=0.099
void plastic identifier
0
0
5  0.25 0.25 0.25  0 0""")
# Add glazing based on percentage
# In case you want to add custom windows
# use Honeybee_addHBGlz component.
glazingcreator = Honeybee_GlazingBasedOnRatio(HBObjects=mass2zone.HBZones, glzRatio=Slider(0, range=0..100), runIt=Toggle(True))  # -> readMe, HBObjWGLZ; plug-in component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
panel_5 = Panel("""void plastic GenericCeiling_80
0
0
5 0.8 0.8 0.8 0 0""")
panel_6 = Panel("""void plastic WhiteInteriorWall_70
0
0
5 0.7 0.7 0.7 0 0""")
radglassmaterial = Honeybee_RadianceGlassMaterial(
    materialName="window_1",
    RTransmittance=number_slider_2,
    GTransmittance=number_slider_2,
    BTransmittance=number_slider_2,
    refractiveIndex=1.52)  # -> avrgTrans, RADMaterial; plug-in component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
# Ceiling
brep = Brep(<brep referenced from the Rhino model>)
# Floor
brep_2 = Brep(<brep referenced from the Rhino model>)

flip = Flip(Surface=brep_2)  # -> Surface, Result
gentestpts = Honeybee_GenerateTestPoints(testGeometry=flip.Surface, gridSize=Slider(1, range=0..1), distBaseSrf=0.2, moveTestMesh=True)  # -> out, simplify(testPoints), simplify(ptsVectors), simplify(facesArea), simplify(mesh); plug-in component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
range = Range(Domain=Domain(0, 3), Steps=3)
unit_z = UnitZ(Factor=range)
move = Move(Geometry=graft(gentestpts.testPoints), Motion=unit_z)  # -> flatten(Geometry), Transform

# ----
# Desk
brep_3 = Brep([<brep referenced from the Rhino model> x10])
# Glass
brep_4 = Brep([<brep referenced from the Rhino model> x10])
# Chair
brep_5 = Brep([<brep referenced from the Rhino model> x192])
# Metal
brep_6 = Brep([<brep referenced from the Rhino model> x6])
# Walls
brep_7 = Brep([<brep referenced from the Rhino model> x4])
createhbsrfs = Honeybee_createHBSrfs(geometry=flatten(brep_7), RADMaterial=panel_6)  # -> readMe, simplify(HBSurface); plug-in component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
createhbsrfs_2 = Honeybee_createHBSrfs(geometry=flatten(brep), RADMaterial=panel_5)  # -> readMe, simplify(HBSurface); plug-in component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
createhbsrfs_3 = Honeybee_createHBSrfs(geometry=flatten(brep_2), RADMaterial=panel)  # -> readMe, simplify(HBSurface); plug-in component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
createhbsrfs_4 = Honeybee_createHBSrfs(geometry=flatten(brep_5), RADMaterial=panel_4)  # -> readMe, simplify(HBSurface); plug-in component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
createhbsrfs_5 = Honeybee_createHBSrfs(geometry=flatten(brep_3), RADMaterial=panel_3)  # -> readMe, simplify(HBSurface); plug-in component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
createhbsrfs_6 = Honeybee_createHBSrfs(geometry=flatten(brep_6), RADMaterial=panel_2)  # -> readMe, simplify(HBSurface); plug-in component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
createhbsrfs_7 = Honeybee_createHBSrfs(geometry=flatten(brep_4), RADMaterial=radglassmaterial.RADMaterial)  # -> readMe, simplify(HBSurface); plug-in component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
false_start_toggle = FalseStartToggle(True)

# ---- group: HB Zone With Glazing
brep_8 = Brep(glazingcreator.HBObjWGLZ)

# ----
unit_z_2 = UnitZ(Factor=1)
open_weather_file = Ladybug_OpenEPWWeatherFile(open=false_start_toggle)  # -> epwFile; plug-in component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
move_2 = Move(Geometry=graft(move.Geometry), Motion=unit_z_2)  # -> flatten(Geometry), Transform
radparameters = Honeybee_RADParameters(quality=0)  # -> out, radParameters; plug-in component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
vector_2pt = Vector2Pt(PointA=move.Geometry, PointB=move_2.Geometry, Unitize=False)  # -> Vector, Length
merge = Merge(
    Data1=flatten(createhbsrfs.HBSurface),
    Data2=flatten(createhbsrfs_2.HBSurface),
    Data3=flatten(createhbsrfs_3.HBSurface),
    Data4=flatten(createhbsrfs_4.HBSurface),
    Data5=flatten(createhbsrfs_5.HBSurface),
    Data6=flatten(createhbsrfs_6.HBSurface),
    Data7=flatten(createhbsrfs_7.HBSurface))
# Put the recipie together!
annualdaylightsimulation = Honeybee_AnnualDaylightSimulation(epwWeatherFile=open_weather_file, testPoints=move.Geometry, ptsVectors=vector_2pt.Vector)  # -> analysisRecipe; plug-in component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
toggle = BooleanToggle(True)
# Run the analysis
rundaylightanalysis = Honeybee_RunDaylightSimulation(
    HBObjects=flatten(merge),
    analysisRecipe=annualdaylightsimulation,
    writeRad=toggle,
    runRad=toggle,
    numOfCPUs="11",
    radFileName="haha",
    overwriteResults=True)  # -> readMe, analysisType, resultsUnit, results, testPts, annual_analysis_files, radGeoFile, studyFolder, done; plug-in component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
occupancygenerator = Honeybee_DaysimOccupancyGenerator(weekendDays=[1, 2], writeTheOcc=Toggle(True))  # -> occupancyFile; plug-in component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
# Generate annual results
readannualresultsi = Honeybee_ReadAnnualResultI(
    illFilesAddress=rundaylightanalysis.annual_analysis_files,
    testPoints=simplify(rundaylightanalysis.testPts),
    occupancyFiles=occupancygenerator,
    DLAIllumThresholds=300,
    runIt=Toggle(True))  # -> DLA, UDLI_Less_100, UDLI_100_2000, UDLI_More_2000, CDA, sDA, annualProfiles, htmReport; plug-in component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
gradientlibrary = Ladybug_GradientLibrary(gradIndex=Slider(1, range=0..10))  # -> customColors; plug-in component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
legendpar = Ladybug_LegendParameters(
    lowBound=Slider(0, range=0..100),
    highBound=Slider(100, range=0..100),
    numSegments=Slider(6, range=0..10),
    customColors=flatten(gradientlibrary))  # -> legendPar; plug-in component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

# ---- group: make it 3D!
dom = ConstructDomain(DomainStart=0, DomainEnd=Slider(1, range=0..1))

# ----
# Visualize the results
recolormesh = Ladybug_RecolorMesh(
    analysisResult=readannualresultsi.DLA,
    heightDomain=dom,
    legendPar=legendpar,
    analysisTitle=rundaylightanalysis.analysisType,
    legendTitle="%")  # -> readMe, newMesh, newLegend, legendBasePt, meshColors, legendColors; plug-in component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
