# Grasshopper definition theSkyResearch.gh (Grasshopper 1.0.7)
# plug-ins: DIVA Daylight, Ironbug.LBHB_Legacy

ladybug_falsestarttoggle = Ladybug_FalseStartToggle(True)
ladybug = Ladybug_Ladybug()  # -> out; plug-in component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
open_weather_file = Ladybug_OpenEPWWeatherFile(open=ladybug_falsestarttoggle)  # -> epwFile; plug-in component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
importepw = Ladybug_ImportEpw(epwFile=open_weather_file)  # -> Output, latitude, location, dryBulbTemperature, dewPointTemperature, relativeHumidity, windSpeed, windDirection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; plug-in component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
strnum = Ladybug_SeparateData(inputList=flatten(importepw.totalSkyCover))  # -> numbers, strings; plug-in component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
analysisperiod = Ladybug_AnalysisPeriod()  # -> out, analysisPeriod; plug-in component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
series = Series(Start=1, Step=1, Count=30)
sunpath = Ladybug_SunPath(
    location=importepw.location,
    hour=12,
    day=21,
    month=12,
    timeStep=1,
    analysisPeriod=analysisperiod.analysisPeriod,
    dailyOrAnnualSunPath=True)  # -> out, sunVectors, sunAltitudes, sunAzimuths, port, sunSpheresMesh, sunPathCrvs, compassCrvs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; plug-in component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
list_item = ListItem(List=strnum.numbers, Index=expr("x - 1", sunpath.sunPositionsHOY), Wrap=True)
number_slider = Slider(3, range=0..10)
analysisperiod_2 = Ladybug_AnalysisPeriod(fromMonth=number_slider, fromDay=1, toMonth=number_slider)  # -> out, analysisPeriod; plug-in component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
sunpath_2 = Ladybug_SunPath(
    location=importepw.location,
    hour=12,
    day=21,
    month=3,
    timeStep=1,
    analysisPeriod=analysisperiod_2.analysisPeriod,
    dailyOrAnnualSunPath=True)  # -> out, sunVectors, sunAltitudes, sunAzimuths, port, sunSpheresMesh, sunPathCrvs, compassCrvs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; plug-in component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
series_2 = Series(Start=1, Step=1, Count=24)
monthdayhour = MonthDayHour(
    HourOfYear=sunpath.sunPositionsHOY,
    BooleanValue_0=False,
    BooleanValue_1=False,
    BooleanValue_2=False,
    Color_0=RGBA(0, 0, 0, 0),
    Color_1=RGBA(0, 0, 0, 0),
    Color_2=RGBA(0, 0, 0, 0),
    Hidden_0=False,
    Hidden_1=True,
    Hidden_2=True,
    IntegerValue_0=8752,
    IntegerValue_1=1,
    IntegerValue_2=1,
    IntervalMax_0=-1.797693135e+308,
    IntervalMax_1=-1.797693135e+308,
    IntervalMax_2=-1.797693135e+308,
    IntervalMin_0=-1.797693135e+308,
    IntervalMin_1=-1.797693135e+308,
    IntervalMin_2=-1.797693135e+308,
    Name_0="Hour of Year",
    Name_1="Day of Year",
    Name_2="Hour of Day",
    NumberValue_0=-1.797693135e+308,
    NumberValue_1=-1.797693135e+308,
    NumberValue_2=-1.797693135e+308,
    OutputHidden_0=False,
    OutputHidden_1=False,
    OutputHidden_2=False,
    OutputName_0="Month",
    OutputName_1="Day",
    OutputName_2="Hour",
    use_doy=False)  # -> Month, Day, Hour
hour_of_year = HourOfYear(Month=number_slider, Day=series, Hour=series_2)  # -> HourOfYear, DayOfYear
strnum_2 = Ladybug_SeparateData(inputList=flatten(importepw.directNormalRadiation))  # -> numbers, strings; plug-in component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
strnum_3 = Ladybug_SeparateData(inputList=flatten(importepw.diffuseHorizontalRadiation))  # -> numbers, strings; plug-in component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
panel = Panel(hour_of_year.HourOfYear)
panel_2 = Panel(sunpath_2.sunPositionsHOY)
sun_position = SunPosition(
    Month=monthdayhour.Month,
    Day=monthdayhour.Day,
    Hour=monthdayhour.Hour,
    BooleanValue_0=False,
    BooleanValue_1=False,
    BooleanValue_2=False,
    BooleanValue_3=False,
    BooleanValue_4=False,
    BooleanValue_5=False,
    BooleanValue_6=False,
    BooleanValue_7=False,
    Color_0=RGBA(0, 0, 0, 0),
    Color_1=RGBA(0, 0, 0, 0),
    Color_2=RGBA(0, 0, 0, 0),
    Color_3=RGBA(0, 0, 0, 0),
    Color_4=RGBA(0, 0, 0, 0),
    Color_5=RGBA(0, 0, 0, 0),
    Color_6=RGBA(0, 0, 0, 0),
    Color_7=RGBA(0, 0, 0, 0),
    Hidden_0=False,
    Hidden_1=True,
    Hidden_2=True,
    Hidden_3=True,
    Hidden_4=True,
    Hidden_5=False,
    Hidden_6=False,
    Hidden_7=False,
    IntegerValue_0=-2147483648,
    IntegerValue_1=-2147483648,
    IntegerValue_2=-2147483648,
    IntegerValue_3=-2147483648,
    IntegerValue_4=-2147483648,
    IntegerValue_5=12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)  # -> SolarVector, Azimuth, Altitude
list_item_2 = ListItem(List=strnum_2.numbers, Index=expr("x - 1", sunpath.sunPositionsHOY), Wrap=True)
list_item_3 = ListItem(List=strnum_3.numbers, Index=expr("x - 1", sunpath.sunPositionsHOY), Wrap=True)
larger_than = LargerThan(FirstNumber=sun_position.Altitude, SecondNumber=0)  # -> LargerThan, OrEqualTo
larger_than_2 = LargerThan(FirstNumber=list_item_2, SecondNumber=0)  # -> LargerThan, OrEqualTo
gate_and = GateAnd(A=larger_than.LargerThan, B=larger_than_2.LargerThan)
cull_pattern = CullPattern(List=list_item, CullPattern=gate_and)
panel_3 = Panel(cull_pattern)
ghpython_script = GhPythonScript(x=monthdayhour.Month, y=monthdayhour.Day, z=monthdayhour.Hour)  # -> out, a
# ---------- ghpython_script: Python ----------
__author__ = "qorba"
__version__ = "2020.11.25"

a = '{}_{}@{}00'.format(x,y,z)
# ---------- end ghpython_script ----------
cull_pattern_2 = CullPattern(List=sunpath.sunPositionsHOY, CullPattern=gate_and)
cull_pattern_3 = CullPattern(List=ghpython_script.a, CullPattern=gate_and)
cull_pattern_4 = CullPattern(List=sun_position.Azimuth, CullPattern=gate_and)
cull_pattern_5 = CullPattern(List=sun_position.Altitude, CullPattern=gate_and)
cull_pattern_6 = CullPattern(List=list_item_2, CullPattern=gate_and)
cull_pattern_7 = CullPattern(List=list_item_3, CullPattern=gate_and)
division = Division(A=cull_pattern_7, B=cull_pattern_6)
panel_4 = Panel(division)
panel_5 = Panel(cull_pattern_3)
panel_6 = Panel(cull_pattern_2)
addition = Addition(A=cull_pattern_4, B=180)
panel_7 = Panel(cull_pattern_7)
panel_8 = Panel(cull_pattern_6)
monthdayhour_2 = MonthDayHour(
    HourOfYear=sunpath.sunPositionsHOY,
    BooleanValue_0=False,
    BooleanValue_1=False,
    BooleanValue_2=False,
    Color_0=RGBA(0, 0, 0, 0),
    Color_1=RGBA(0, 0, 0, 0),
    Color_2=RGBA(0, 0, 0, 0),
    Hidden_0=False,
    Hidden_1=True,
    Hidden_2=True,
    IntegerValue_0=8752,
    IntegerValue_1=1,
    IntegerValue_2=1,
    IntervalMax_0=-1.797693135e+308,
    IntervalMax_1=-1.797693135e+308,
    IntervalMax_2=-1.797693135e+308,
    IntervalMin_0=-1.797693135e+308,
    IntervalMin_1=-1.797693135e+308,
    IntervalMin_2=-1.797693135e+308,
    Name_0="Hour of Year",
    Name_1="Day of Year",
    Name_2="Hour of Day",
    NumberValue_0=-1.797693135e+308,
    NumberValue_1=-1.797693135e+308,
    NumberValue_2=-1.797693135e+308,
    OutputHidden_0=False,
    OutputHidden_1=False,
    OutputHidden_2=False,
    OutputName_0="Month",
    OutputName_1="Day",
    OutputName_2="Hour",
    use_doy=False)  # -> Month, Day, Hour
list_length = ListLength(List=cull_pattern_2)
panel_9 = Panel(cull_pattern_4)
sun_position_2 = SunPosition(
    Month=monthdayhour.Month,
    Day=monthdayhour.Day,
    Hour=monthdayhour.Hour,
    BooleanValue_0=False,
    BooleanValue_1=False,
    BooleanValue_2=False,
    BooleanValue_3=False,
    BooleanValue_4=False,
    BooleanValue_5=False,
    BooleanValue_6=False,
    BooleanValue_7=False,
    Color_0=RGBA(0, 0, 0, 0),
    Color_1=RGBA(0, 0, 0, 0),
    Color_2=RGBA(0, 0, 0, 0),
    Color_3=RGBA(0, 0, 0, 0),
    Color_4=RGBA(0, 0, 0, 0),
    Color_5=RGBA(0, 0, 0, 0),
    Color_6=RGBA(0, 0, 0, 0),
    Color_7=RGBA(0, 0, 0, 0),
    Hidden_0=False,
    Hidden_1=True,
    Hidden_2=True,
    Hidden_3=True,
    Hidden_4=True,
    Hidden_5=False,
    Hidden_6=False,
    Hidden_7=False,
    IntegerValue_0=-2147483648,
    IntegerValue_1=-2147483648,
    IntegerValue_2=-2147483648,
    IntegerValue_3=-2147483648,
    IntegerValue_4=-2147483648,
    IntegerValue_5=12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)  # -> SolarVector, Azimuth, Altitude
panel_10 = Panel(list_length)
sky = Sky(
    Month=monthdayhour_2.Month,
    Day=monthdayhour_2.Day,
    Hour=monthdayhour_2.Hour,
    BooleanValue_0=False,
    BooleanValue_1=False,
    BooleanValue_2=False,
    BooleanValue_3=False,
    BooleanValue_4=False,
    BooleanValue_5=False,
    BooleanValue_6=False,
    BooleanValue_7=False,
    BooleanValue_8=False,
    BooleanValue_9=False,
    Color_0=RGBA(0, 0, 0, 0),
    Color_1=RGBA(0, 0, 0, 0),
    Color_2=RGBA(0, 0, 0, 0),
    Color_3=RGBA(0, 0, 0, 0),
    Color_4=RGBA(0, 0, 0, 0),
    Color_5=RGBA(0, 0, 0, 0),
    Color_6=RGBA(0, 0, 0, 0),
    Color_7=RGBA(0, 0, 0, 0),
    Color_8=RGBA(0, 0, 0, 0),
    Color_9=RGBA(0, 0, 0, 0),
    Hidden_0=False,
    Hidden_1=False,
    Hidden_2=False,
    Hidden_3=False,
    Hidden_4=False,
    Hidden_5=True,
    Hidden_6=True,
    Hidden_7=True,
    Hidden_8=True,
    Hidden_9=True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)
panel_11 = Panel(cull_pattern_5)
null_item = NullItem(Item=sky)  # -> NullFlags, InvalidFlags, Description
ghpython_script_2 = GhPythonScript(x=monthdayhour_2.Month, y=monthdayhour_2.Day, z=monthdayhour_2.Hour)  # -> out, a; same code as ghpython_script
cull_pattern_8 = CullPattern(List=ghpython_script_2.a, CullPattern=invert(null_item.NullFlags))
cull_pattern_9 = CullPattern(List=sun_position_2.Azimuth, CullPattern=invert(null_item.NullFlags))
cull_pattern_10 = CullPattern(List=sun_position_2.Altitude, CullPattern=invert(null_item.NullFlags))
panel_12 = Panel(cull_pattern_8)
panel_13 = Panel(cull_pattern_9)
panel_14 = Panel(cull_pattern_10)
entwine = Entwine(
    Branch00=cull_pattern_3,
    Branch01=cull_pattern_6,
    Branch02=cull_pattern_7,
    Branch03=cull_pattern_5,
    Branch04=cull_pattern_4,
    FlattenInputs=True)
list_item_4 = ListItem(List=entwine, Index=Slider(1517, range=0..4141), Wrap=True)  # -> flatten(Item)
panel_15 = Panel(list_item_4)
