# Grasshopper definition unnamed.gh (Grasshopper 1.0.7)
# plug-ins: DIVA Daylight, FalseStartToggle

ladybug = Ladybug_Ladybug()  # -> out; plug-in component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
honeybee = Honeybee_Honeybee()  # -> out; plug-in component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
number_slider = Slider(0.76, range=0..1)
open_weather_file = Ladybug_OpenEPWWeatherFile(open=Toggle(True))  # -> epwFile; plug-in component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
brep = Brep(<brep referenced from the Rhino model>)
importepw = Ladybug_ImportEpw(epwFile=open_weather_file)  # -> Output, latitude, location, dryBulbTemperature, dewPointTemperature, relativeHumidity, windSpeed, windDirection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; plug-in component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
gentestpts = Honeybee_GenerateTestPoints(testGeometry=brep, gridSize=1, distBaseSrf=0.01, moveTestMesh=True)  # -> out, simplify(testPoints), simplify(ptsVectors), simplify(facesArea), simplify(mesh); plug-in component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
radglassmaterial = Honeybee_RadianceGlassMaterial(
    materialName="window_1",
    RTransmittance=number_slider,
    GTransmittance=number_slider,
    BTransmittance=number_slider,
    refractiveIndex=1.52)  # -> avrgTrans, RADMaterial; plug-in component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
# Metal
mesh = Mesh(<mesh referenced from the Rhino model>)
# Monitors
mesh_2 = Mesh([<mesh referenced from the Rhino model> x7])
# Ceiling
mesh_3 = Mesh(<mesh referenced from the Rhino model>)
# Glass
mesh_4 = Mesh([<mesh referenced from the Rhino model> x3])
# Floor
mesh_5 = Mesh(<mesh referenced from the Rhino model>)
# Chair
mesh_6 = Mesh(<mesh referenced from the Rhino model>)
# Desk
mesh_7 = Mesh(<mesh referenced from the Rhino model>)
# Walls
mesh_8 = Mesh([<mesh referenced from the Rhino model> x4])
analysisperiod = Ladybug_AnalysisPeriod()  # -> out, analysisPeriod; plug-in component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
createhbsrfs = Honeybee_createHBSrfs(geometry=mesh, srfType=0)  # -> out, simplify(HBSurface); plug-in component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
createhbsrfs_2 = Honeybee_createHBSrfs(geometry=mesh_4, srfType=5, RADMaterial=radglassmaterial.RADMaterial)  # -> out, simplify(HBSurface); plug-in component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
genclimatebasedsky = Honeybee_GenerateClimateBasedSky(weatherFile=open_weather_file, month=3, day=21, hour=16)  # -> out, skyFilePath; plug-in component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
createhbsrfs_3 = Honeybee_createHBSrfs(geometry=mesh_8, srfType=0)  # -> out, simplify(HBSurface); plug-in component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
createhbsrfs_4 = Honeybee_createHBSrfs(geometry=mesh_3, srfType=3)  # -> out, simplify(HBSurface); plug-in component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
createhbsrfs_5 = Honeybee_createHBSrfs(geometry=mesh_5, srfType=2)  # -> out, simplify(HBSurface); plug-in component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
createhbsrfs_6 = Honeybee_createHBSrfs(geometry=mesh_6, srfType=0)  # -> out, simplify(HBSurface); plug-in component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
createhbsrfs_7 = Honeybee_createHBSrfs(geometry=mesh_7, srfType=0)  # -> out, simplify(HBSurface); plug-in component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
createhbsrfs_8 = Honeybee_createHBSrfs(geometry=mesh_2, srfType=0)  # -> out, simplify(HBSurface); plug-in component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
radparameters = Honeybee_RADParameters(quality=2, ab=6)  # -> out, radParameters; plug-in component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
annualdaylightsimulation = Honeybee_AnnualDaylightSimulation(
    epwWeatherFile=open_weather_file,
    testPoints=gentestpts.testPoints,
    ptsVectors=gentestpts.ptsVectors,
    radParameters=radparameters.radParameters)  # -> analysisRecipe; plug-in component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
wea = HoneybeePlus_WEAFromEPW(epw_file=open_weather_file)  # -> wea; plug-in component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
false_start_toggle = FalseStartToggle(False)
sunpath = Ladybug_SunPath(
    location=importepw.location,
    hour=12,
    day=21,
    month=12,
    timeStep=1,
    analysisPeriod=analysisperiod.analysisPeriod,
    dailyOrAnnualSunPath=True,
    solarOrStandardTime=0)  # -> out, sunVectors, sunAltitudes, sunAzimuths, port, sunSpheresMesh, sunPathCrvs, compassCrvs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; plug-in component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
# -ps 2 -pt .05 -pj .9 -dj .7 -ds .15 -dt .05 -dc .75 -dr 3 -dp 512 -st .15 -ab 4 -aa .1 -ar 512 -ad 2048 -as 1024 -lr 8 -lw .005
day_month_hour_calculator = Ladybug_Day_Month_Hour(HOY=sunpath.sunPositionsHOY)  # -> day, month, hour, date; plug-in component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
panel = Panel(genclimatebasedsky.skyFilePath)
imagebasedsimulation = Honeybee_ImageBasedSimulation(
    skyFile=genclimatebasedsky.skyFilePath,
    rhinoViewsName="View #1",
    cameraType=0,
    simulationType=2,
    imageWidth=1280,
    imageHeight=720,
    radParameters=radparameters.radParameters,
    backupImages=0)  # -> analysisRecipe; plug-in component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
brep_2 = Brep(flatten([createhbsrfs_3.HBSurface, createhbsrfs_4.HBSurface, createhbsrfs_5.HBSurface, createhbsrfs_6.HBSurface, createhbsrfs_2.HBSurface, createhbsrfs_8.HBSurface, createhbsrfs_7.HBSurface, createhbsrfs.HBSurface]))
rundaylightanalysis = Honeybee_RunDaylightSimulation(
    HBObjects=flatten(brep_2),
    analysisRecipe=annualdaylightsimulation,
    writeRad=1,
    runRad=Toggle(False),
    numOfCPUs=1,
    overwriteResults=True)  # -> out, analysisType, resultsUnit, results, testPts, resultFiles, radGeoFile, studyFolder, done; plug-in component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
monthdayhour = MonthDayHour(
    HourOfYear=sunpath.sunPositionsHOY,
    BooleanValue_0=False,
    BooleanValue_1=False,
    BooleanValue_2=False,
    Color_0=RGBA(0, 0, 0, 0),
    Color_1=RGBA(0, 0, 0, 0),
    Color_2=RGBA(0, 0, 0, 0),
    Hidden_0=False,
    Hidden_1=True,
    Hidden_2=True,
    IntegerValue_0=8752,
    IntegerValue_1=1,
    IntegerValue_2=1,
    IntervalMax_0=-1.797693135e+308,
    IntervalMax_1=-1.797693135e+308,
    IntervalMax_2=-1.797693135e+308,
    IntervalMin_0=-1.797693135e+308,
    IntervalMin_1=-1.797693135e+308,
    IntervalMin_2=-1.797693135e+308,
    Name_0="Hour of Year",
    Name_1="Day of Year",
    Name_2="Hour of Day",
    NumberValue_0=-1.797693135e+308,
    NumberValue_1=-1.797693135e+308,
    NumberValue_2=-1.797693135e+308,
    OutputHidden_0=False,
    OutputHidden_1=False,
    OutputHidden_2=False,
    OutputName_0="Month",
    OutputName_1="Day",
    OutputName_2="Hour",
    use_doy=False)  # -> Month, Day, Hour
imagebasedsimulation_2 = Honeybee_ImageBasedSimulation(simulationType=2, backupImages=0)  # -> analysisRecipe; plug-in component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
day_month_hour_calculator_2 = Ladybug_Day_Month_Hour(HOY=sunpath.sunPositionsHOY)  # -> day, month, hour, date; plug-in component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
climatebased = HoneybeePlus_ClimatebasedSky(
    wea=wea,
    month=day_month_hour_calculator_2.month,
    day=day_month_hour_calculator_2.day,
    hour=day_month_hour_calculator_2.hour)  # -> sky; plug-in component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
rundaylightanalysis_2 = Honeybee_RunDaylightSimulation(
    HBObjects=flatten(brep_2),
    analysisRecipe=imagebasedsimulation,
    writeRad=True,
    runRad=false_start_toggle,
    numOfCPUs=Slider(11, range=1..12),
    radFileName="thesisRoom10_30",
    overwriteResults=True)  # -> out, analysisType, resultsUnit, results, testPts, luminance_files, radGeoFile, studyFolder, done; plug-in component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
sky = Sky(
    Month=day_month_hour_calculator_2.month,
    Day=day_month_hour_calculator_2.day,
    Hour=day_month_hour_calculator_2.hour,
    BooleanValue_0=False,
    BooleanValue_1=False,
    BooleanValue_2=False,
    BooleanValue_3=False,
    BooleanValue_4=False,
    BooleanValue_5=False,
    BooleanValue_6=False,
    BooleanValue_7=False,
    BooleanValue_8=False,
    BooleanValue_9=False,
    Color_0=RGBA(0, 0, 0, 0),
    Color_1=RGBA(0, 0, 0, 0),
    Color_2=RGBA(0, 0, 0, 0),
    Color_3=RGBA(0, 0, 0, 0),
    Color_4=RGBA(0, 0, 0, 0),
    Color_5=RGBA(0, 0, 0, 0),
    Color_6=RGBA(0, 0, 0, 0),
    Color_7=RGBA(0, 0, 0, 0),
    Color_8=RGBA(0, 0, 0, 0),
    Color_9=RGBA(0, 0, 0, 0),
    Hidden_0=False,
    Hidden_1=False,
    Hidden_2=False,
    Hidden_3=False,
    Hidden_4=False,
    Hidden_5=True,
    Hidden_6=True,
    Hidden_7=True,
    Hidden_8=True,
    Hidden_9=True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)
brep_3 = Brep(<brep referenced from the Rhino model>)
brep_4 = Brep(<brep referenced from the Rhino model>)
daylighting_grid = DaylightingGrid(
    Geometry=brep_3,
    Spacing=0.45,
    BooleanValue_0=False,
    BooleanValue_1=False,
    BooleanValue_10=False,
    BooleanValue_11=False,
    BooleanValue_12=False,
    BooleanValue_13=False,
    BooleanValue_14=False,
    BooleanValue_15=False,
    BooleanValue_16=False,
    BooleanValue_17=False,
    BooleanValue_18=False,
    BooleanValue_19=False,
    BooleanValue_2=False,
    BooleanValue_20=False,
    BooleanValue_21=False,
    BooleanValue_22=False,
    BooleanValue_3=False,
    BooleanValue_4=False,
    BooleanValue_5=False,
    BooleanValue_6=False,
    BooleanValue_7=False,
    BooleanValue_8=False,
    BooleanValue_9=False,
    Color_0=RGBA(0, 0, 0, 0),
    Color_1=RGBA(0, 0, 0, 0),
    Color_10=RGBA(0, 0, 0, 0),
    Color_11=RGBA(0, 0, 0, 0),
    Color_12=RGBA(0, 0, 0, 0),
    Color_13=RGBA(0, 0, 0, 0),
    Color_14=RGBA(0, 0, 0, 0)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)
scene_object = SceneObject(
    Geometry=brep_4,
    BooleanValue_0=False,
    BooleanValue_1=False,
    Color_0=RGBA(0, 0, 0, 0),
    Color_1=RGBA(0, 0, 0, 0),
    Hidden_0=False,
    Hidden_1=False,
    IntegerValue_0=-2147483648,
    IntegerValue_1=-2147483648,
    IntervalMax_0=-1.797693135e+308,
    IntervalMax_1=-1.797693135e+308,
    IntervalMin_0=-1.797693135e+308,
    IntervalMin_1=-1.797693135e+308,
    Name_0="Geometry",
    Name_1="Material",
    NumberValue_0=-1.797693135e+308,
    NumberValue_1=-1.797693135e+308,
    OutputHidden_0=False,
    OutputName_0="Scene Object",
    TextValuePersistent_1="Glazing_DoublePane_Clear_80",
    TextValueVolatile_1="Glazing_DoublePane_Clear_80")
null_item = NullItem(Item=sky)  # -> NullFlags, InvalidFlags, Description
brep_5 = Brep([<brep referenced from the Rhino model> x6])
scene_object_2 = SceneObject(
    Geometry=brep_5,
    BooleanValue_0=False,
    BooleanValue_1=False,
    Color_0=RGBA(0, 0, 0, 0),
    Color_1=RGBA(0, 0, 0, 0),
    Hidden_0=False,
    Hidden_1=False,
    IntegerValue_0=-2147483648,
    IntegerValue_1=-2147483648,
    IntervalMax_0=-1.797693135e+308,
    IntervalMax_1=-1.797693135e+308,
    IntervalMin_0=-1.797693135e+308,
    IntervalMin_1=-1.797693135e+308,
    Name_0="Geometry",
    Name_1="Material",
    NumberValue_0=-1.797693135e+308,
    NumberValue_1=-1.797693135e+308,
    OutputHidden_0=False,
    OutputName_0="Scene Object",
    TextValuePersistent_1="PlasterFloor_70",
    TextValueVolatile_1="PlasterFloor_70")
gate_not = GateNot(A=null_item.NullFlags)
merge = Merge(Data1=scene_object_2, Data2=scene_object)
cull_pattern = CullPattern(List=sky, CullPattern=gate_not)
camera = Camera(
    XDim=400,
    YDim=400,
    BooleanValue_0=False,
    BooleanValue_1=False,
    BooleanValue_10=False,
    BooleanValue_11=False,
    BooleanValue_12=False,
    BooleanValue_13=False,
    BooleanValue_2=False,
    BooleanValue_3=False,
    BooleanValue_4=False,
    BooleanValue_5=False,
    BooleanValue_6=False,
    BooleanValue_7=False,
    BooleanValue_8=False,
    BooleanValue_9=False,
    Color_0=RGBA(0, 0, 0, 0),
    Color_1=RGBA(0, 0, 0, 0),
    Color_10=RGBA(0, 0, 0, 0),
    Color_11=RGBA(0, 0, 0, 0),
    Color_12=RGBA(0, 0, 0, 0),
    Color_13=RGBA(0, 0, 0, 0),
    Color_2=RGBA(0, 0, 0, 0),
    Color_3=RGBA(0, 0, 0, 0),
    Color_4=RGBA(0, 0, 0, 0),
    Color_5=RGBA(0, 0, 0, 0),
    Color_6=RGBA(0, 0, 0, 0),
    Color_7=RGBA(0, 0, 0, 0),
    Color_8=RGBA(0, 0, 0, 0),
    Color_9=RGBA(0, 0, 0, 0),
    Hidden_0=True,
    Hidden_1=False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)
annual_daylight = AnnualDaylight(
    Name="123",
    Grids=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,
    Objects=merge,
    RhinoScene=False,
    Run=False,
    BooleanValue_0=False,
    BooleanValue_1=False,
    BooleanValue_10=False,
    BooleanValue_11=False,
    BooleanValue_12=True,
    BooleanValue_13=False,
    BooleanValue_14=False,
    BooleanValue_15=False,
    BooleanValue_16=False,
    BooleanValue_17=False,
    BooleanValue_2=False,
    BooleanValue_3=False,
    BooleanValue_4=False,
    BooleanValue_5=False,
    BooleanValue_6=False,
    BooleanValue_7=False,
    BooleanValue_8=False,
    BooleanValue_9=False,
    Color_0=RGBA(0, 0, 0, 0),
    Color_1=RGBA(0, 0, 0, 0),
    Color_10=RGBA(0, 0, 0, 0),
    Color_11=RGBA(0, 0, 0, 0),
    Color_12=RGBA(0, 0, 0, 0),
    Color_13=RGBA(0, 0, 0, 0),
    Color_14=RGBA(0, 0, 0, 0),
    Color_15=RGBA(0, 0, 0, 0),
    Color_16=RGBA(0, 0, 0, 0),
    Color_17=RGBA(0, 0, 0, 0),
    Color_2=RGBA(0, 0, 0, 0),
    Color_3=RGBA(0, 0, 0, 0)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)  # -> Out, SDA, ASE, LEEDv4, LightingEnergy, OpenPercentage, Windows, Grids, Zones
visualization = Visualization(
    Name="aaa",
    Camera=camera,
    Objects=scene_object_2,
    RhinoScene=False,
    Sky=cull_pattern,
    Run=Button(),
    BooleanValue_0=False,
    BooleanValue_1=False,
    BooleanValue_10=False,
    BooleanValue_11=False,
    BooleanValue_12=False,
    BooleanValue_13=False,
    BooleanValue_14=False,
    BooleanValue_15=False,
    BooleanValue_16=False,
    BooleanValue_17=False,
    BooleanValue_18=False,
    BooleanValue_19=False,
    BooleanValue_2=False,
    BooleanValue_20=False,
    BooleanValue_21=False,
    BooleanValue_22=True,
    BooleanValue_23=True,
    BooleanValue_24=False,
    BooleanValue_25=False,
    BooleanValue_26=False,
    BooleanValue_27=False,
    BooleanValue_3=False,
    BooleanValue_4=False,
    BooleanValue_5=False,
    BooleanValue_6=False,
    BooleanValue_7=False,
    BooleanValue_8=False,
    BooleanValue_9=True,
    Color_0=RGBA(0, 0, 0, 0),
    Color_1=RGBA(0, 0, 0, 0)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)  # -> Out, Pic, Image, Falsecolor
