# Grasshopper definition wip.gh (Grasshopper 1.0.7)
# plug-ins: DIVA Daylight

ladybug = Ladybug_Ladybug()  # -> out; plug-in component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
open_weather_file = Ladybug_OpenEPWWeatherFile(open=Toggle(True))  # -> epwFile; plug-in component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
importepw = Ladybug_ImportEpw(epwFile=open_weather_file)  # -> Output, latitude, location, dryBulbTemperature, dewPointTemperature, relativeHumidity, windSpeed, windDirection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; plug-in component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
analysisperiod = Ladybug_AnalysisPeriod()  # -> out, analysisPeriod; plug-in component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
sunpath = Ladybug_SunPath(location=importepw.location, hour=7, day=15, month=2, timeStep=1, dailyOrAnnualSunPath=True)  # -> out, sunVectors, sunAltitudes, sunAzimuths, port, sunSpheresMesh, sunPathCrvs, compassCrvs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; plug-in component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
sunpath_2 = Ladybug_SunPath(
    location=importepw.location,
    hour=12,
    day=21,
    month=12,
    timeStep=1,
    analysisPeriod=analysisperiod.analysisPeriod,
    dailyOrAnnualSunPath=0,
    solarOrStandardTime=True)  # -> out, sunVectors, sunAltitudes, sunAzimuths, port, sunSpheresMesh, sunPathCrvs, compassCrvs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; plug-in component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
panel = Panel(sunpath_2.sunAltitudes)
panel_2 = Panel(sunpath_2.sunPositionsInfo)
day_month_hour_calculator = Ladybug_Day_Month_Hour(HOY=sunpath_2.sunPositionsHOY)  # -> day, month, hour, date; plug-in component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
sky = Sky(
    Month=day_month_hour_calculator.month,
    Day=day_month_hour_calculator.day,
    Hour=day_month_hour_calculator.hour,
    BooleanValue_0=False,
    BooleanValue_1=False,
    BooleanValue_2=False,
    BooleanValue_3=False,
    BooleanValue_4=False,
    BooleanValue_5=False,
    BooleanValue_6=False,
    BooleanValue_7=False,
    BooleanValue_8=False,
    BooleanValue_9=False,
    Color_0=RGBA(0, 0, 0, 0),
    Color_1=RGBA(0, 0, 0, 0),
    Color_2=RGBA(0, 0, 0, 0),
    Color_3=RGBA(0, 0, 0, 0),
    Color_4=RGBA(0, 0, 0, 0),
    Color_5=RGBA(0, 0, 0, 0),
    Color_6=RGBA(0, 0, 0, 0),
    Color_7=RGBA(0, 0, 0, 0),
    Color_8=RGBA(0, 0, 0, 0),
    Color_9=RGBA(0, 0, 0, 0),
    Hidden_0=False,
    Hidden_1=False,
    Hidden_2=False,
    Hidden_3=False,
    Hidden_4=False,
    Hidden_5=True,
    Hidden_6=True,
    Hidden_7=True,
    Hidden_8=True,
    Hidden_9=True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)
null_item = NullItem(Item=sky)  # -> NullFlags, InvalidFlags, Description
gate_not = GateNot(A=null_item.NullFlags)
cull_pattern = CullPattern(List=sky, CullPattern=gate_not)
panel_3 = Panel(cull_pattern)
